vi "AMTopLevel.gvi"   [LabVIEW NXG 5.0.0]
panel controls:
  "C amplitude": f64 = 1
  "C frequency": f64 = 10
  "C sample rate": f64 = 1000
  "C samples": i32 = 1000
  "C t0": timestamp = 1-01-01T00:00:00Z
  "M amplitude": f64 = 1
  "M frequency": f64 = 10
  "M sample rate": f64 = 1000
  "M samples": i32 = 1000
  "M t0": timestamp = 1-01-01T00:00:00Z
  "cutoff frequency": f64 = 0.125
  "order": i32 = 2
  "stop": bool
panel indicators:
  "envelope demodulated time signal": waveform<f64>
  "coherent demodulated time signal": waveform<f64>
  "envelope PSD demodulaed signal": T1
  "coherent PSD demodulated signal": T1
types:
  T1 = cluster{"f0": f64, "df": f64, "magnitude": f64[]}
diagram:
  while {
    call "AMSub.gvi"(C amplitude=$"C amplitude", C frequency=$"C frequency", C sample rate=$"C sample rate", C samples=$"C samples", C t0=$"C t0", M amplitude=$"M amplitude", M frequency=$"M frequency", M sample rate=$"M sample rate", M samples=$"M samples", M t0=$"M t0") -> (carrier signal=w1, AM waveform=w2)
    call "AMCoherent.gvi"(AM Signal=w2, carrier Signal=w1, cutoff frequency=$"cutoff frequency", order=$order) -> (demodulated time signal=w3, PSD demodulated signal=w4)
    $"coherent demodulated time signal" <- w3
    $"coherent PSD demodulated signal" <- w4
    call "AMEnvelopeDetection.gvi"(AM signal=w2, cutoff frequency=$"cutoff frequency", order=$order) -> (demodulated time signal=w5, PSD demodulated signal=w6)
    $"envelope demodulated time signal" <- w5
    $"envelope PSD demodulaed signal" <- w6
    stop if $stop
  }
