vi "FMTopLevel.gvi"   [LabVIEW NXG 5.0.0]
panel controls:
  "frequencyM": f64 = 10
  "k": f64
  "sample rate": f64 = 1000
  "samples": i32 = 1000
  "amplitudeM": f64 = 1
  "amplitudeC": f64 = 1
  "frequencyC": f64 = 10
  "cutoff frequency": f64 = 0.125
  "order": i32 = 2
panel indicators:
  "FM signal in time": waveform<f64>
  "FM signal PSD": T1
  "Demodulated signal in time": waveform<f64>
  "Demodulated signal PSD": T1
types:
  T1 = cluster{"f0": f64, "df": f64, "magnitude": f64[]}
diagram:
  call "FM_Modulator.gvi"(amplitudeM=$amplitudeM, frequencyM=$frequencyM, k=$k, t0=1904-01-01T00:00:00Z, sample rate=$"sample rate", samples=$samples, amplitudeC=$amplitudeC, frequencyC=$frequencyC) -> (FM waveform: Time Domain=w1, FM waveform: Frequency Domain=w2)
  call "FM_Demodulator.gvi"(cutoff frequency=$"cutoff frequency", order=$order, waveform in=w1) -> (Demodulated signal in time=w3, Demodulated signal PSD=w4)
  $"Demodulated signal in time" <- w3
  $"Demodulated signal PSD" <- w4
  $"FM signal in time" <- w1
  $"FM signal PSD" <- w2
