vi "FM_Demodulator.gvi"   [LabVIEW NXG 5.0.0]
inputs:
  "cutoff frequency": f64 = 0.125
  "order": i32 = 2
  "waveform in": waveform<f64> = {dt=1, Y=[]}
outputs:
  "Demodulated signal in time": waveform<f64>
  "Demodulated signal PSD": T1
types:
  T1 = cluster{"f0": f64, "df": f64, "magnitude": f64[]}
uses:
  NI::Analysis::IntegralDifferentiation::Derivative x(t).gvi
  NI::Analysis::Filtering::Butterworth Lowpass Filter (Waveform).gvi
  NI::Analysis::Measurement::AC DC and RMS (single-shot)(Wfm).gvi
  NI::Analysis::Measurement::Power Spectral Density for 1 Chan.gvi
diagram:
  Property Node(instance in=$"waveform in") -> ("Y"=w1, "dt"=w2, "t0"=w3, "attributes"=w4)
  call "Derivative x(t).gvi"(dt=w2, x(t)=w1) -> (dx(t)/dt=w5)
  Multiply(w5, f64 default) -> w6
  for {
    w7 = each element of w6
    w8 = each element of w6
    Is Greater Than 0(x=w7) -> w10
    Select(s=w10, t=w8, f=0) -> w11
    append w11 to w9
  }
  Build Waveform Node(Y=w9, attributes=w4, dt=w2, t0=w3) -> (output waveform=w12)
  call "Butterworth Lowpass Filter (Waveform).gvi"(signal=w12, cutoff frequency=$"cutoff frequency", order=$order) -> (filtered signal=w13)
  call "AC DC and RMS (single-shot)(Wfm).gvi"(signal=w12) -> (DC value=w14)
  Waveform Subtract(x=w13, y=w14) -> w15
  $"Demodulated signal in time" <- w15
  call "Power Spectral Density for 1 Chan.gvi"(signal=w15) -> (power spectral density=w16)
  $"Demodulated signal PSD" <- w16
