vi "FM_Modulator.gvi"   [LabVIEW NXG 5.0.0]
inputs:
  "amplitudeM": f64 = 1
  "frequencyM": f64 = 10
  "k": f64
  "t0": timestamp = 1-01-01T00:00:00Z
  "sample rate": f64 = 1000
  "samples": i32 = 1000
  "amplitudeC": f64 = 1
  "frequencyC": f64 = 10
outputs:
  "FM waveform: Time Domain": waveform<f64>
  "FM waveform: Frequency Domain": T1
  "Message Waveform: Time Domain": waveform<f64>
  "Message Waveform: Frequency Domain": T1
types:
  T1 = cluster{"f0": f64, "df": f64, "magnitude": f64[]}
uses:
  NI::Analysis::Generation::Sine Waveform.gvi
  NI::Analysis::IntegralDifferentiation::Integral x(t).gvi
  NI::Analysis::Measurement::Power Spectral Density for 1 Chan.gvi
diagram:
  call "Sine Waveform.gvi"(sample rate=$"sample rate", samples=$samples, t0=$t0, amplitude=$amplitudeC, frequency=$frequencyC, phase in=90) -> (sine wave=w1)
  call "Sine Waveform.gvi"(sample rate=$"sample rate", samples=$samples, t0=$t0, amplitude=$amplitudeM, frequency=$frequencyM, phase in=0) -> (sine wave=w2)
  Property Node(instance in=w2) -> ("Y"=w3, "dt"=w4)
  call "Integral x(t).gvi"(dt=w4, x(t)=w3) -> (integral x(t)=w5)
  Multiply($k, f64 default) -> w6
  Multiply(w5, w6) -> w7
  Sine And Cosine(x=w7) -> (cos(x)=w8, sin(x)=w9)
  Build Waveform Node(Y=w8, dt=w4, t0=$t0) -> (output waveform=w10)
  Waveform Multiply(w10, w1) -> w11
  call "Sine Waveform.gvi"(sample rate=$"sample rate", samples=$samples, t0=$t0, amplitude=$amplitudeC, frequency=$frequencyC, phase in=0) -> (sine wave=w12)
  Build Waveform Node(Y=w9, dt=w4, t0=$t0) -> (output waveform=w13)
  Waveform Multiply(w13, w12) -> w14
  Waveform Subtract(x=w11, y=w14) -> w15
  call "Power Spectral Density for 1 Chan.gvi"(signal=w15) -> (power spectral density=w16)
  $"FM waveform: Frequency Domain" <- w16
  call "Power Spectral Density for 1 Chan.gvi"(signal=w2) -> (power spectral density=w17)
  $"Message Waveform: Frequency Domain" <- w17
  $"FM waveform: Time Domain" <- w15
  $"Message Waveform: Time Domain" <- w2
