vi "BPSK_Tx_Rx_FEC.gvi"   [LabVIEW NXG 5.0.0]
panel controls:
  "IQ rate": f64 = 200000
  "device names": "USRP niUSRPClass"
  "carrier frequency": f64 = 400000000
  "gain Tx": f64
  "active antenna Tx": string = "TX1"
  "stop Tx": bool
  "gain Rx": f64
  "active antenna Rx": string = "RX2"
  "Symbol rate": f64
  "message length": i32 = 128
  "M": i32 = 16
panel indicators:
  "Baseband Waveform": waveform<f64>
  "Baseband Power Spectrum_Tx": T1
  "input": i8[]
  "recived array": i16[]
  "BER": f64
  "trigger found?": bool
  "Baseband Waveform Rx": waveform<f64>
  "Baseband Power Spectrum_Rx": T1
  "input incoded": i8[]
  "recievd decoded": f64[]
types:
  T1 = cluster{"f0": f64, "df": f64, "magnitude": f64[]}
uses:
  NI::USRP::niUSRP Open Rx Session.gvi
  NI::USRP::niUSRP Configure Signal.gvi
  NI::USRP::niUSRP Initiate.gvi
  NI::USRP::niUSRP Fetch Rx Data (CDB).gvi
  NI::USRP::niUSRP Close Session.gvi
  NI::Modulation::MT Generate Filter Coefficients.gvi
  NI::Analysis::Operations::1D Convolution (DBL).gvi
  NI::Analysis::Resampling::Decimate (single shot, DBL).gvi
  NI::Modulation::MT Calculate BER After Trigger (Fibonacci PN Sequence).gvi
  NI::Modulation::MT Generate Bits (Fibonacci, PN Order).gvi
  NI::Analysis::Resampling::Upsample (DBL).gvi
  NI::USRP::niUSRP Open Tx Session.gvi
  NI::USRP::niUSRP Write Tx Data (CDB).gvi
diagram:
  # Transmitter
  call "niUSRP Open Rx Session.gvi"(device names=$"device names") -> (session handle out=w1, error out=w2)
  call "niUSRP Configure Signal.gvi"(active antenna=$"active antenna Rx", session handle=w1, error in=w2, IQ rate=$"IQ rate", carrier frequency=$"carrier frequency", gain=$"gain Rx") -> (session handle out=w3, error out=w4, coerced carrier frequency=w5)
  Subtract(x=w5, y=20000) -> w6
  Property Node(instance in=w3, "niUSRP"=w6) -> (instance out=w7)
  call "niUSRP Initiate.gvi"(session handle=w7, error in=w4) -> (session handle out=w8, error out=w9)
  call "niUSRP Fetch Rx Data (CDB).gvi"(session handle=w8, error in=w9, number of samples=1000000) -> (session handle out=w10, error out=w11, data=w12)
  call "niUSRP Close Session.gvi"(session handle=w10, error in=w11)
  Reciprocal(x=$"IQ rate") -> w13
  call "MT Generate Filter Coefficients.gvi"(pulse shaping filter="Root Raised Cos", matched samples per symbol=$M, modulation type="PSK") -> (matched filter coefficients=w14)
  call "FrameSync (Complex).gvi"(Sampled Input=w12) -> (Aligned Samples=w15)
  call "Channel Estimator.gvi"(input signal=w15) -> (signal out=w16)
  Complex To Real And Imaginary(x + iy=w16) -> w17
  call "1D Convolution (DBL).gvi"(x=w17, y=w14) -> (x * y=w18)
  w19 = cluster{"t0": timestamp, "dt": f64, "Y": c128[]} {all zero or empty}
  Property Node(instance in=w19, "dt"=w13, "Y"=w18) -> (instance out=w20)
  call "FFT Power Spectrum for 1 Chan (CDB)2.gvi"(time signal=w20, dB On (F)=TRUE) -> (power spectrum=w21)
  $"Baseband Power Spectrum_Rx" <- w21
  call "PulseAlign (Real).gvi"(Input signal=w18) -> (aligned output=w22)
  call "Decimate (single shot, DBL).gvi"(signal=w22, decimating factor=$M) -> (decimated signal=w23)
  call "FrameSync (Real).gvi"(Sampled Input=w23) -> (Aligned Samples=w24)
  for {
    w25 = each element of w24
    Is Greater Than 0(x=w25) -> w27
    Boolean To 0 Or 1(Boolean=w27) -> (0, 1=w28)
    append w28 to w26
  }
  Multiply($"message length", 3) -> w29
  Array Subset(array=w26, index0=0, length0=w29) -> w30
  Reshape Array(inArray=w30, size=$"message length", size=3) -> w31
  for {
    w32 = each element of w31
    Add Array Elements(numeric array=w32) -> (sum=w34)
    Is Greater(x=w34, y=1) -> w35
    Select(s=w35, t=1, f=0) -> w36
    append w36 to w33
  }
  $"recievd decoded" <- w33
  $"recived array" <- w30
  call "MT Calculate BER After Trigger (Fibonacci PN Sequence).gvi"(input bit stream=w33, BER trigger threshold=0.4) -> (BER=w37, trigger found?=w38)
  $BER <- w37
  $"trigger found?" <- w38
  Divide(x=$"IQ rate", y=$"Symbol rate") -> w39
  call "MT Generate Bits (Fibonacci, PN Order).gvi"(total bits=$"message length") -> (output bit stream=w40)
  for {
    w41 = each element of w40
    Build Array(w41, w41, w41) -> w43
    concatenate w43 onto w42
  }
  Multiply(w42, 2) -> w44
  Subtract(x=w44, y=1) -> w45
  call "AddFrameHeader.gvi"(array=w45) -> (output array=w46)
  call "Upsample (DBL).gvi"(signal=w46, upsampling factor=w39) -> (upsampled signal=w47)
  call "MT Generate Filter Coefficients.gvi"(pulse shaping filter="Root Raised Cos", pulse shaping samples per symbol=w39, modulation type="PSK") -> (pulse shaping filter coefficients=w48)
  call "1D Convolution (DBL).gvi"(x=w47, y=w48) -> (x * y=w49)
  call "Quick Scale 1D.gvi"(X=w49) -> (Y[i]=X[i]/Max|X|=w50)
  w51 = cluster{"t0": timestamp, "dt": f64, "Y": c128[]} {all zero or empty}
  Property Node(instance in=w51, "dt"=w13, "Y"=w50) -> (instance out=w52)
  call "FFT Power Spectrum for 1 Chan (CDB)2.gvi"(time signal=w52, dB On (F)=TRUE) -> (power spectrum=w53)
  $"Baseband Power Spectrum_Tx" <- w53
  Build Waveform Node(Y=w18, dt=w13) -> (output waveform=w54)
  $"Baseband Waveform Rx" <- w54
  $"input incoded" <- w42
  # Receiver
  $input <- w40
  call "niUSRP Open Tx Session.gvi"(device names=$"device names") -> (session handle out=w55, error out=w56)
  call "niUSRP Configure Signal.gvi"(active antenna=$"active antenna Tx", session handle=w55, error in=w56, IQ rate=$"IQ rate", carrier frequency=$"carrier frequency", gain=$"gain Tx") -> (session handle out=w57, error out=w58)
  Polar To Complex(r=w50, theta=0) -> (r * e^(i*theta)=w59)
  call "Insert Pilots.gvi"(signal input=w59) -> (output signal=w60)
  call "AddFrameHeader (complex).gvi"(array=w60) -> (output array=w61)
  while {
    call "niUSRP Write Tx Data (CDB).gvi"(session handle=w57, error in=w58, data=w61) -> (session handle out=w62, error out=w63)
    stop if $"stop Tx"
  }
  call "niUSRP Close Session.gvi"(session handle=w62, error in=w63)
  Build Waveform Node(Y=w50, dt=w13) -> (output waveform=w64)
  $"Baseband Waveform" <- w64
