vi "BPSK_Tx_Rx_Template.gvi"   [LabVIEW NXG 5.0.0]
panel controls:
  "IQ rate": f64 = 200000
  "device names": "USRP niUSRPClass"
  "carrier frequency": f64 = 400000000
  "gain Tx": f64
  "active antenna Tx": string = "TX1"
  "stop Tx": bool
  "gain Rx": f64
  "active antenna Rx": string = "RX2"
  "Symbol rate": f64
  "total bits": i32 = 128
panel indicators:
  "Baseband Waveform": waveform<f64>
  "Baseband Power Spectrum_Tx": T1
  "output bit stream": i8[]
types:
  T1 = cluster{"f0": f64, "df": f64, "magnitude": f64[]}
uses:
  NI::USRP::niUSRP Open Tx Session.gvi
  NI::USRP::niUSRP Configure Signal.gvi
  NI::Modulation::MT Generate Bits (Fibonacci, PN Order).gvi
  NI::Analysis::Resampling::Upsample (DBL).gvi
  NI::Modulation::MT Generate Filter Coefficients.gvi
  NI::Analysis::Operations::1D Convolution (DBL).gvi
  NI::USRP::niUSRP Write Tx Data (CDB).gvi
  NI::USRP::niUSRP Close Session.gvi
  NI::USRP::niUSRP Open Rx Session.gvi
  NI::USRP::niUSRP Initiate.gvi
  NI::USRP::niUSRP Fetch Rx Data (CDB).gvi
diagram:
  call "niUSRP Open Tx Session.gvi"(device names=$"device names") -> (session handle out=w1, error out=w2)
  call "niUSRP Configure Signal.gvi"(active antenna=$"active antenna Tx", session handle=w1, error in=w2, IQ rate=$"IQ rate", carrier frequency=$"carrier frequency", gain=$"gain Tx") -> (session handle out=w3, error out=w4)
  Divide(x=$"IQ rate", y=$"Symbol rate") -> w5
  call "MT Generate Bits (Fibonacci, PN Order).gvi"(total bits=$"total bits") -> (output bit stream=w6)
  # Transmitter
  Multiply(w6, [2]) -> w7
  Subtract(x=w7, y=[1]) -> w8
  call "AddFrameHeader.gvi"(array=w8) -> (output array=w9)
  call "Upsample (DBL).gvi"(signal=w9, upsampling factor=w5) -> (upsampled signal=w10)
  call "MT Generate Filter Coefficients.gvi"(pulse shaping filter="none", pulse shaping samples per symbol=w5, modulation type="PSK") -> (pulse shaping filter coefficients=w11)
  call "1D Convolution (DBL).gvi"(x=w10, y=w11) -> (x * y=w12)
  call "Quick Scale 1D.gvi"(X=w12) -> (Y[i]=X[i]/Max|X|=w13)
  To Single Precision Complex(number=w13) -> w14
  call "Insert Pilots.gvi"(signal input=w14) -> (output signal=w15)
  call "AddFrameHeader (complex).gvi"(array=w15) -> (output array=w16)
  while {
    call "niUSRP Write Tx Data (CDB).gvi"(session handle=w3, error in=w4, data=w16) -> (session handle out=w17, error out=w18)
    stop if $"stop Tx"
  }
  call "niUSRP Close Session.gvi"(session handle=w17, error in=w18)
  call "niUSRP Open Rx Session.gvi"(device names=$"device names") -> (session handle out=w19, error out=w20)
  call "niUSRP Configure Signal.gvi"(active antenna=$"active antenna Rx", session handle=w19, error in=w20, IQ rate=$"IQ rate", carrier frequency=$"carrier frequency", gain=$"gain Rx") -> (session handle out=w21, error out=w22, coerced carrier frequency=w23)
  Subtract(x=w23, y=20000) -> w24
  Property Node(instance in=w21, "niUSRP"=w24) -> (instance out=w25)
  call "niUSRP Initiate.gvi"(session handle=w25, error in=w22) -> (session handle out=w26, error out=w27)
  call "niUSRP Fetch Rx Data (CDB).gvi"(session handle=w26, error in=w27, number of samples=1000000) -> (session handle out=w28, error out=w29)
  call "niUSRP Close Session.gvi"(session handle=w28, error in=w29)
  # Receiver
  $"output bit stream" <- w6
  Reciprocal(x=$"Symbol rate") -> w30
  Build Waveform Node(Y=w13, dt=w30) -> (output waveform=w31)
  $"Baseband Waveform" <- w31
  w32 = cluster{"t0": timestamp, "dt": f64, "Y": c128[]} {all zero or empty}
  Property Node(instance in=w32, "dt"=w30, "Y"=w13) -> (instance out=w33)
  call "FFT Power Spectrum for 1 Chan (CDB)2.gvi"(time signal=w33, dB On (F)=TRUE) -> (power spectrum=w34)
  $"Baseband Power Spectrum_Tx" <- w34
