vi "DPSK_Tx_Rx.gvi"   [LabVIEW NXG 5.0.0]
panel controls:
  "IQ rate": f64 = 200000
  "device names": "USRP niUSRPClass"
  "carrier frequency": f64 = 400000000
  "gain Tx": f64
  "active antenna Tx": string = "TX1"
  "stop Tx": bool
  "gain Rx": f64
  "active antenna Rx": string = "RX2"
  "Symbol rate": f64
  "message length": i32 = 128
  "M": i32 = 16
panel indicators:
  "Baseband Waveform": waveform<f64>
  "Baseband Power Spectrum_Tx": T1
  "output bits": i16[]
  "BER": f64
  "trigger found?": bool
  "Baseband Waveform Rx": waveform<c128>
  "Baseband Power Spectrum_Rx": T1
  "output array": f64[]
  "Output": f64[]
types:
  T1 = cluster{"f0": f64, "df": f64, "magnitude": f64[]}
uses:
  NI::USRP::niUSRP Open Tx Session.gvi
  NI::USRP::niUSRP Configure Signal.gvi
  NI::Modulation::MT Generate Filter Coefficients.gvi
  NI::Modulation::MT Generate Bits (Fibonacci, PN Order).gvi
  NI::Analysis::Resampling::Upsample (DBL).gvi
  NI::Analysis::Operations::1D Convolution (DBL).gvi
  NI::USRP::niUSRP Write Tx Data (CDB).gvi
  NI::USRP::niUSRP Close Session.gvi
  NI::USRP::niUSRP Open Rx Session.gvi
  NI::USRP::niUSRP Initiate.gvi
  NI::USRP::niUSRP Fetch Rx Data (CDB).gvi
  NI::Analysis::Operations::1D Convolution (CDB).gvi
  NI::Analysis::Resampling::Decimate (single shot, CDB).gvi
  NI::Analysis::Resampling::Decimate (single shot, DBL).gvi
  NI::Modulation::MT Calculate BER After Trigger (Fibonacci PN Sequence).gvi
diagram:
  call "niUSRP Open Tx Session.gvi"(device names=$"device names") -> (session handle out=w1, error out=w2)
  call "niUSRP Configure Signal.gvi"(active antenna=$"active antenna Tx", session handle=w1, error in=w2, IQ rate=$"IQ rate", carrier frequency=$"carrier frequency", gain=$"gain Tx") -> (session handle out=w3, error out=w4)
  Divide(x=$"IQ rate", y=$"Symbol rate") -> w5
  call "MT Generate Filter Coefficients.gvi"(pulse shaping filter="Root Raised Cos", pulse shaping samples per symbol=w5, modulation type="PSK") -> (pulse shaping filter coefficients=w6)
  call "MT Generate Bits (Fibonacci, PN Order).gvi"(total bits=$"message length") -> (output bit stream=w7)
  Multiply(w7, 2) -> w8
  Subtract(x=w8, y=1) -> w9
  call "AddFrameHeader.gvi"(array=w9) -> (output array=w10)
  for (iteration -> i1) {
    w11 = each element of w10
    Is Equal To 0(x=i1) -> w13
    Feedback Node(input=w14) -> w15
    Multiply(w11, w15) -> w16
    Select(s=w13, t=1, f=w16) -> w14
    append w14 to w12
  }
  call "Upsample (DBL).gvi"(signal=w12, upsampling factor=w5) -> (upsampled signal=w17)
  call "1D Convolution (DBL).gvi"(x=w17, y=w6) -> (x * y=w18)
  call "Quick Scale 1D.gvi"(X=w18) -> (Y[i]=X[i]/Max|X|=w19)
  Polar To Complex(r=w19, theta=0) -> (r * e^(i*theta)=w20)
  while {
    call "niUSRP Write Tx Data (CDB).gvi"(session handle=w3, error in=w4, data=w20) -> (session handle out=w21, error out=w22)
    stop if $"stop Tx"
  }
  call "niUSRP Close Session.gvi"(session handle=w21, error in=w22)
  Reciprocal(x=$"IQ rate") -> w23
  Build Waveform Node(Y=w19, dt=w23) -> (output waveform=w24)
  $"Baseband Waveform" <- w24
  $Output <- w12
  w25 = cluster{"t0": timestamp, "dt": f64, "Y": c128[]} {all zero or empty}
  Property Node(instance in=w25, "dt"=w23, "Y"=w19) -> (instance out=w26)
  call "FFT Power Spectrum for 1 Chan (CDB)2.gvi"(time signal=w26, dB On (F)=TRUE) -> (power spectrum=w27)
  $"Baseband Power Spectrum_Tx" <- w27
  # Transmitter
  call "niUSRP Open Rx Session.gvi"(device names=$"device names") -> (session handle out=w28, error out=w29)
  call "niUSRP Configure Signal.gvi"(active antenna=$"active antenna Rx", session handle=w28, error in=w29, IQ rate=$"IQ rate", carrier frequency=$"carrier frequency", gain=$"gain Rx") -> (session handle out=w30, error out=w31, coerced carrier frequency=w32)
  Subtract(x=w32, y=20000) -> w33
  Property Node(instance in=w30, "niUSRP"=w33) -> (instance out=w34)
  call "niUSRP Initiate.gvi"(session handle=w34, error in=w31) -> (session handle out=w35, error out=w36)
  call "niUSRP Fetch Rx Data (CDB).gvi"(session handle=w35, error in=w36, number of samples=1000000) -> (session handle out=w37, error out=w38, data=w39)
  call "MT Generate Filter Coefficients.gvi"(pulse shaping filter="Root Raised Cos", matched samples per symbol=$M, modulation type="PSK") -> (matched filter coefficients=w40)
  call "1D Convolution (CDB).gvi"(x=w39, y=w40) -> (x * y=w41)
  Build Waveform Node(Y=w41, dt=w23) -> (output waveform=w42)
  $"Baseband Waveform Rx" <- w42
  w43 = cluster{"t0": timestamp, "dt": f64, "Y": c128[]} {all zero or empty}
  Property Node(instance in=w43, "dt"=w23, "Y"=w41) -> (instance out=w44)
  call "FFT Power Spectrum for 1 Chan (CDB)2.gvi"(time signal=w44, dB On (F)=TRUE) -> (power spectrum=w45)
  $"Baseband Power Spectrum_Rx" <- w45
  $"output array" <- w10
  call "PulseAlign (Complex).gvi"(Input signal=w41) -> (aligned output=w46)
  call "Decimate (single shot, CDB).gvi"(signal=w46, decimating factor=$M) -> (decimated signal=w47)
  for {
    w48 = each element of w47
    Feedback Node(input=w48) -> w50
    Complex Conjugate(x + iy=w50) -> w51
    Multiply(w51, w48) -> w52
    append w52 to w49
  }
  call "FrameSync (Complex).gvi"(Sampled Input=w49) -> (Aligned Samples=w53)
  Complex To Real And Imaginary(x + iy=w53) -> w54
  for {
    w55 = each element of w54
    Is Greater Than 0(x=w55) -> w57
    Boolean To 0 Or 1(Boolean=w57) -> (0, 1=w58)
    append w58 to w56
  }
  Array Subset(array=w56, index0=0, length0=$"message length") -> w59
  $"output bits" <- w59
  call "Decimate (single shot, DBL).gvi"()
  call "MT Calculate BER After Trigger (Fibonacci PN Sequence).gvi"(input bit stream=w59, BER trigger threshold=0.4) -> (BER=w60, trigger found?=w61)
  $BER <- w60
  $"trigger found?" <- w61
  call "niUSRP Close Session.gvi"(session handle=w37, error in=w38)
