vi "AMEnvelopeDetection.gvi"   [LabVIEW NXG 5.0.0]
inputs:
  "AM signal": waveform<f64> = {dt=1, Y=[]}
  "cutoff frequency": f64 = 0.125
  "order": i32 = 2
outputs:
  "demodulated time signal": waveform<f64>
  "PSD demodulated signal": T1
types:
  T1 = cluster{"f0": f64, "df": f64, "magnitude": f64[]}
uses:
  NI::Analysis::Measurement::AC DC and RMS (single-shot)(Wfm).gvi
  NI::Analysis::Filtering::Butterworth Lowpass Filter (Waveform).gvi
  NI::Analysis::Measurement::Power Spectrum for 1 Chan.gvi
diagram:
  Waveform Multiply($"AM signal", f64 default) -> w1
  Property Node(instance in=w1) -> ("Y"=w2, "dt"=w3, "t0"=w4, "attributes"=w5)
  for {
    w6 = each element of w2
    w7 = each element of w2
    Is Greater Or Equal To 0(x=w6) -> w9
    Select(s=w9, t=w7, f=0) -> w10
    append w10 to w8
  }
  Build Waveform Node(Y=w8, attributes=w5, dt=w3, t0=w4) -> (output waveform=w11)
  call "AC DC and RMS (single-shot)(Wfm).gvi"(signal=w11) -> (DC value=w12)
  call "Butterworth Lowpass Filter (Waveform).gvi"(signal=w11, cutoff frequency=$"cutoff frequency", order=$order) -> (filtered signal=w13)
  Waveform Subtract(x=w13, y=w12) -> w14
  $"demodulated time signal" <- w14
  call "Power Spectrum for 1 Chan.gvi"(signal=w14) -> (power spectrum=w15)
  $"PSD demodulated signal" <- w15
