vi "AMSub.gvi"   [LabVIEW NXG 5.0.0]
inputs:
  "C amplitude": f64 = 1
  "C frequency": f64 = 10
  "C sample rate": f64 = 1000
  "C samples": i32 = 1000
  "C t0": timestamp = 1-01-01T00:00:00Z
  "M amplitude": f64 = 1
  "M frequency": f64 = 10
  "M sample rate": f64 = 1000
  "M samples": i32 = 1000
  "M t0": timestamp = 1-01-01T00:00:00Z
outputs:
  "carrier signal": waveform<f64>
  "message signal": waveform<f64>
  "AM waveform": waveform<f64>
  "PSD message signal": T1
  "PSD AM waveform": T1
types:
  T1 = cluster{"f0": f64, "df": f64, "magnitude": f64[]}
uses:
  NI::Analysis::Generation::Sine Waveform.gvi
  NI::Analysis::Measurement::Power Spectral Density for 1 Chan.gvi
diagram:
  call "Sine Waveform.gvi"(sample rate=$"C sample rate", samples=$"C samples", t0=$"C t0", amplitude=$"C amplitude", frequency=$"C frequency", phase in=90) -> (sine wave=w1)
  $"carrier signal" <- w1
  call "Sine Waveform.gvi"(sample rate=$"M sample rate", samples=$"M samples", t0=$"M t0", amplitude=$"M amplitude", frequency=$"M frequency", phase in=90) -> (sine wave=w2)
  $"message signal" <- w2
  Waveform Add(w1, $"M amplitude") -> w3
  Waveform Divide(x=w2, y=$"M amplitude") -> w4
  Waveform Multiply(w3, w4) -> w5
  $"AM waveform" <- w5
  call "Power Spectral Density for 1 Chan.gvi"(signal=w5) -> (power spectral density=w6)
  $"PSD AM waveform" <- w6
  call "Power Spectral Density for 1 Chan.gvi"(signal=w2) -> (power spectral density=w7)
  $"PSD message signal" <- w7
